# Grasshopper definition 250322_colors by footprint.gh (Grasshopper 1.0.8)
# plug-ins: Speckle 2, Heteroptera, Pufferfish

list = Accounts(
    {"No account selected": , "Account (esteban.alvarez.ruiz@students.iaac.net | https://macad.speckle.xyz)": "https://macad.speckle.xyz/?id=617e0c5545"}, selected="Account (esteban.alvarez.ruiz@students.iaac.net | https://macad.speckle.xyz)",
    FirstSelectedItem="https://macad.speckle.xyz/?id=617e0c5545")
panel = Panel("https://macad.speckle.xyz/projects/f6fd1ebba3/models/29f596e9d7")
sget = StreamGet(StreamIDURL=panel, SpeckleAccount=list)
receive = Receive(
    Stream=sget,
    AutoReceive=False,
    CurrentComponentState="up_to_date",
    ExpandOutput=True,
    LastInfoMessage="Esteban Alvarez @ 03/22/2025 11:46:24:  (id:eb2216028e)",
    ReceiveOnOpen=False,
    ReceivedCommitId="eb2216028e",
    StreamWrapper="https://macad.speckle.xyz/projects/f6fd1ebba3/models/main?u=617e0c5545",
    selectedKitName="Objects")  # -> Info, CollectionType, Elements, Info_2, Name, Types, Units
dso = DeconstructSpeckleObject(SpeckleObject=receive.Elements, selectedKitName="Objects")  # -> CollectionType, Elements, Name, Units
dso_2 = DeconstructSpeckleObject(SpeckleObject=dso.Elements, selectedKitName="Objects")  # -> BaseLine, BasePoints, BuiltInCategory, Category, DisplayValue, ElementId, Family, Flipped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
panel_2 = Panel(dso_2.ElementId)
panel_3 = Panel(dso.Elements)
panel_4 = Panel(dso_2.DisplayValue)
geo = Geometry(simplify(dso_2.DisplayValue))
dso_3 = DeconstructSpeckleObject(SpeckleObject=dso_2.MaterialQuantities, selectedKitName="Objects")  # -> Area, simplify(Emission_factor_Kg_co₂_m³), Family, Length, Material, Object_name, simplify(Total_carbon_footprint_Kg_co₂), Units, Volume, Volume_M³
dso_4 = DeconstructSpeckleObject(SpeckleObject=dso_2.Parameters, selectedKitName="Objects")  # -> _0a80a6d495714df6967703211e72047a, _74b1142d1fae4be5B45f43329c8998c4, ALL_MODEL_DESCRIPTION, ALL_MODEL_IMAGE, ALL_MODEL_INSTANCE_COMMENTS, ALL_MODEL_MANUFACTURER, ALL_MODEL_MARK, ALL_MODEL_MODEL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
item = ListItem(List=geo, Index=0, Wrap=True)
panel_5 = Panel(dso_3.Total_carbon_footprint_Kg_co₂)
panel_6 = Panel(dso_2.Parameters)
panel_7 = Panel(dso_4.MaterialFace2)
flatten = FlattenTree(Tree=panel_5, Path="{0}")
bnd = Bounds(Numbers=flatten)
graft = GraftTree(Tree=geo, IncludeEmptyLists=True, IncludeNullItems=True)
metavector = MetaVector()
panel_8 = Panel(dso_3.Emission_factor_Kg_co₂_m³)
dedomain = DeconstructDomain(Domain=bnd)  # -> Start, End
trim = TrimTree(Tree=panel_5, Depth=1)
gradient = Gradient(
    LowerLimit=dedomain.Start,
    UpperLimit=dedomain.End,
    Parameter=trim,
    stops=[0: RGB(0, 128, 0), 0.5: RGB(255, 255, 0), 1: RGB(255, 0, 0)])
lng = ListLength(List=geo)
disjoint = DisjointMesh(Mesh=geo)
repeat = RepeatData(Length=lng)
panel_9 = Panel(trim)
trim_2 = TrimTree(Tree=disjoint, Depth=1)
unweld = UnweldMesh(Mesh=trim_2, Angle=1.570796327)
mcol = MeshColours(Mesh=trim_2, Colours=gradient)
preview = CustomPreview(Geometry=trim_2, Material=gradient)
msh2psrf = MeshToPolysurface(Mesh=trim_2, Triangles=False, FaceMerge=False)
panel_10 = Panel(trim_2)
